# Grasshopper definition Proportion and Position.gh (Grasshopper 1.0.7)
# plug-ins: ScriptSync

talk_panel_create = Button()
c_script = CSharpScript(CreatePanel=talk_panel_create, y="Talk To Me")  # -> out, A; inputs CreatePanel: Boolean
# ---------- c_script: C# usings ----------
using Microsoft.VisualBasic;
# ---------- c_script: C# ----------
        string Panel=null;

        if (CreatePanel)  
        {
            Grasshopper.Kernel.Special.GH_Panel VoicePanelIntake = new Grasshopper.Kernel.Special.GH_Panel();
            VoicePanelIntake.CreateAttributes();
            VoicePanelIntake.UserText = "Talk To Me";

            int inputcount = this.Component.Params.Input[1].SourceCount;
            VoicePanelIntake.Attributes.Pivot = new System.Drawing.PointF((float)this.Component.Attributes.DocObject.Attributes.Bounds.Left - VoicePanelIntake.Attributes.Bounds.Width - 30, (float)this.Component.Params.Input[1].Attributes.Bounds.Y + inputcount * 30);

            GrasshopperDocument.AddObject(VoicePanelIntake, false);
            this.Component.Params.Input[1].AddSource(VoicePanelIntake);

            Panel = VoicePanelIntake.UserText;
        }
# ---------- c_script: C# additional code ----------
    public class FurnitureUnit
    {
        public string FurnitureUnitName { get; set; }
        public Dictionary<string, BodyParts> ListOfBodyParts;
        public Dictionary<string, BodyVoidArea> ListOfVoidAreas;
        
        private ProportionManager _proportionManager;
        private PositionManager _positionManager;
        

        public FurnitureUnit()
        {
            _proportionManager=new ProportionManager();
            _positionManager=new  PositionManager();
        }


        public void CreateBodyParts(string partNameFromVoice)
        {
            //create a new dictionary for the unit if none is presented 
            if (ListOfBodyParts==null)
                ListOfBodyParts=new Dictionary<string, BodyParts>();
            

            //check if body part is already made
            if (!ListOfBodyParts.ContainsKey(partNameFromVoice))
            {
                BodyParts build = new BodyParts();
                
                //initiate information from proportion and position manager
                build.BodyPartBoundingBox = _proportionManager.ConfigureBodies(partNameFromVoice);

                //add body part to the dictionary
                ListOfBodyParts.Add(partNameFromVoice,build);
            }
        }
    }



    public class BodyParts
    {
        public BoundingBox BodyPartBoundingBox;
    }

    public class BodyVoidArea
    {
        public BoundingBox VoidArea;
    }


    //class responsible for taking in input from the user on how the bounding boxes should match each other
    public class ProportionManager
    {
        private string BackStyle;
        private string LeftArmStyle;
        private string RightArmStyle;

        private double ThinStyleRatio=0.75;
        private double NormalStyleRatio=1;
        private double MediumStyleRatio=1.25;
        private double ThickStyleRatio=1.5;

        private double DeckHeight;

        private bool CentralBoundingBoxSet = false;
        private double UnitLength;
        private double UnitHeight;
        private double UnitDepth;


        public void SetDeckHeight()
        { 
            //prompt user to set height via hard coded number or via general sizing ideas
            DeckHeight = double.Parse(Microsoft.VisualBasic.Interaction.InputBox("How would you like to set the height of the deck? \nManual number or by height", "Deck Height", "enter response here", 100, 100));
        }

        //user sets the proportion styles of these body parts
        //and the configure bodies reverts back to this style
        public void SetProportionStyles(string style)
        {
            BackStyle = "thin";
            LeftArmStyle = "Normal";
        }

        //process takes in body part via string, uses the over all sizing of the central
        //box to develop a ratio according to the style set and returns a numbered ratio
        //maybe this isn't the spot for the bounding box to actually be made
        public BoundingBox ConfigureBodies(string intakeSpeech)
        {
            if (!CentralBoundingBoxSet)
              return ConfigureFirstBody();
            else
            {
                return new BoundingBox();
            }
        }
        
        //process sets the deck height along with
        //the overall dimensions of the unit
        public BoundingBox ConfigureFirstBody()
        {


            CentralBoundingBoxSet = true;
            return new BoundingBox();
        }


    }




    ///it maybe a good idea for the position manager to have versions of simply retangular furniture vs wavy or other shaped units
    public class PositionManager
    {
        private double LengthMax;
        private double DepthMax;
        private double HeightMax;
        

        //the user tells the unit what its max size can be, in the
        //real application, this would be balanced in the prep areas
        public void GatherMaxDims()
        {

        }


        //this method controls the cross over placement
        //of a body in comparision to others 

        //does the arm sit outside above or inline with 
        //the deck?
        public void SetPositionOutside()
        {

        }

        public void SetDeckPosition()
        {

        }

        public void SetBodyTransRelationship()
        {

        }

        //this is a simple move with the idea of left,right,up,down
        public void MoveBody()
        {

        }

        //this is a more complex move that allows for a body to be
        //moved in comparision to a different body
        public void MoveBody(string body1, string body2, string direction)
        {

        }
    }
# ---------- end c_script ----------
scriptsync = ScriptSync(
    externalCodeFileName="C:\Users\Zack Sickman\Desktop\Summer2019\Summer Working Code\ScriptSync_2018.10.31\Release\ScriptSyncExternalScripts_VS\ScriptSyncExternalScripts\JuneBuilds\ProportionsPositions.cs",
    targetScriptComponentGuid=c_script)
panel = Panel(c_script.out)
c_script_2 = CSharpScript(X=Slider(0.25, range=0..1))  # -> Out, A
crv = Curve([<curve referenced from the Rhino model> x2])
divide = DivideCurve(Curve=crv, Count=Slider(9, range=0..10), Kinks=False)  # -> Points, Tangents, Parameters
